# Grasshopper definition 1-Create Simply Supported Beam Layers with Attributes.gh (Grasshopper 1.0.8)
# plug-ins: eleFront

specify_layer_names = Panel("beam")
length_m = Slider(57.428, range=0..100)
layer = ModelLayer(Layer=specify_layer_names, Name=specify_layer_names)  # -> Layer, Name, Hidden, Locked, DisplayColour, Material, Linetype
ef_layer = EleFrontLayer(Layer=layer.Layer)  # -> Layer, FullPath, Hidden, Locked, DisplayColour, MaterialName, Linetype, PrintColour, PrintWidth
pt = ConstructPoint(XCoordinate=expr("-x/2", length_m), YCoordinate=0, ZCoordinate=0)
pt_2 = ConstructPoint(XCoordinate=expr("x/2", length_m), YCoordinate=0, ZCoordinate=0)
panel = Panel("""mat
sec
angle""")
panel_2 = Panel("""0
0
0""")
ln = Line(StartPoint=pt, EndPoint=pt_2)

# ----
# Create Layer
ef_att = EleFrontAttributes(Keys=panel, Values=panel_2, Layer=ef_layer.Layer)  # -> Attributes, Keys, Values, Name, Layer, ColourSource, DisplayColour, MaterialSource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

panel_3 = Panel("""1
1
1
1
1
1""")
panel_4 = Panel("""fy
fz
rx""")
panel_5 = Panel("""fx
fy
fz
rx
ry
rz""")
panel_6 = Panel("""1
1
1
1
1
1""")
end = EndPoints(Curve=ln)  # -> Start, End
bc = Point(end.Start)
bc_2 = Point(end.End)

# ----
# Create BCs
u_text = UserText(Content=bc, Keys=panel_5, Values=panel_3, UserTextMode=1)  # -> Content, Keys, Values
u_text_2 = UserText(Content=bc_2, Keys=panel_4, Values=panel_6, UserTextMode=1)  # -> Content, Keys, Values

# ----
# Create Beam with mat, sec and angle
bake = BakeObjects(Geometry=ln, Attributes=ef_att.Attributes, Bake=False, createGroups=False)  # -> Message, Guids
