# Grasshopper definition 2-UDL Pin-Pin Ends Indeterminate Beam.gh (Grasshopper 1.0.8)
# plug-ins: eleFront, OpenSeesUtility

specify_layer_names = Panel("beam")
specify_layer_names_2 = Panel("bnds")
length_m = Slider(57.428, range=0..100)
layer = ModelLayer(Layer=specify_layer_names, Name=specify_layer_names)  # -> Layer, Name, Hidden, Locked, DisplayColour, Material, Linetype
layer_2 = ModelLayer(Layer=specify_layer_names_2, Name=specify_layer_names_2)  # -> Layer, Name, Hidden, Locked, DisplayColour, Material, Linetype
ef_layer = EleFrontLayer(Layer=layer.Layer)  # -> Layer, FullPath, Hidden, Locked, DisplayColour, MaterialName, Linetype, PrintColour, PrintWidth
pt = ConstructPoint(XCoordinate=expr("-x/2", length_m), YCoordinate=0, ZCoordinate=0)
pt_2 = ConstructPoint(XCoordinate=expr("x/2", length_m), YCoordinate=0, ZCoordinate=0)
panel = Panel("""mat
sec
angle""")
panel_2 = Panel("""0
0
0""")
ln = Line(StartPoint=pt, EndPoint=pt_2)

# ----
# Create Layer
ef_att = EleFrontAttributes(Keys=panel, Values=panel_2, Layer=ef_layer.Layer)  # -> Attributes, Keys, Values, Name, Layer, ColourSource, DisplayColour, MaterialSource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

panel_3 = Panel("""1
1
1
1
1
1""")
panel_4 = Panel("""fy
fz
rx""")
panel_5 = Panel("""fx
fy
fz
rx
ry
rz""")
panel_6 = Panel("""1
1
1
1
1
1""")
end = EndPoints(Curve=ln)  # -> Start, End
bc = Point(end.Start)
bc_2 = Point(end.End)

# ----
# Create BCs
u_text = UserText(Content=bc, Keys=panel_5, Values=panel_3, UserTextMode=1)  # -> Content, Keys, Values
u_text_2 = UserText(Content=bc_2, Keys=panel_4, Values=panel_6, UserTextMode=1)  # -> Content, Keys, Values

# ----
# Create Beam with mat, sec and angle
bake = BakeObjects(Geometry=ln, Attributes=ef_att.Attributes, Bake=False, createGroups=False)  # -> Message, Guids

item = ListItem(List=panel, Index=0, Wrap=True)  # -> Item, Item1, Item2
number_slider = Slider(0, range=0..100)

# ----
# Most problamatic Plugin :(
readbeam2 = ReadBeam2(
    LayerBeam=specify_layer_names,
    NameMat=item.Item,
    NameSec=item.Item1,
    NameAngle=item.Item2,
    NameJoint="joint",
    NameLb=["lby", "lbz"],
    NameBar="bar",
    NameWick=["wickX", "wickY", "wickZ", "wickW"],
    NameEle_w=["ele_wx", "ele_wy", "ele_wz", "ele_wx2", "ele_wy2", "ele_wz2", "ele_l1", "ele_l2"],
    NameK=["kxt", "kxc", "kyt", "kyc", "kzt", "kzc", "mx", "my", "mz"],
    NameAngleSpring="angle",
    NameSpring_a=["Nta", "Nca", "Qyta", "Qyca", "Qzta", "Qzca", "Mxa", "Mya", "Mza"],
    RigidPinValue=[1e+12, 0.001],
    Accuracy=0.005)  # -> Beam, Mat, Sec, Angle, Joint, Lby, Lbz, Bar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

assemblelines = MakeRAndIJFromGeometry(Lines=readbeam2.Beam, MaterialNoList=readbeam2.Mat, SectionNoList=readbeam2.Sec, ElementAngleList=readbeam2.Angle)  # -> Nodal_coordinates, Element_node_relationship
boundary = SetBoundaryCondition(
    Nodal_coordinates=assemblelines.Nodal_coordinates,
    XCoordinates=-9999,
    YCoordinates=-9999,
    ZCoordinates=-9999,
    Fx=1,
    Fy=1,
    Fz=1,
    Rx=0,
    Ry=0,
    Rz=0)
lineload = SetLineLoads(
    Nodal_coordinates=assemblelines.Nodal_coordinates,
    Element_node_relationship=assemblelines.Element_node_relationship,
    XCoordinatesOfElementCenterPoint=number_slider,
    YCoordinatesOfElementCenterPoint=number_slider,
    ZCoordinatesOfElementCenterPoint=number_slider,
    DistributedLoadOfXAxisDirection=0,
    DistributedLoadOfYAxisDirection=0,
    DistributedLoadOfZAxisDirection=Slider(-9, range=-10..-1))
visualizemodel = VisualizeStructuralModel(
    Nodal_coordinates=assemblelines.Nodal_coordinates,
    Element_node_relationship=assemblelines.Element_node_relationship,
    Element_node_relationshipShell=-9999,
    KABE_W=-9999,
    Nodal_force=-9999,
    Line_force=lineload,
    Surface_force=-9999,
    Boundary_condition=boundary,
    JointCondition=-9999,
    SpringElement=-9999,
    Index=-9999,
    IndexShell=-9999,
    IndexKabe=-9999,
    IndexSpring=-9999,
    Fontsize=20,
    Arrowsize=0.15,
    Arcsize=0.25)  # -> Nodal_coordinates, Element_node_relationship, Element_node_relationshipShell, KABE_W, Nodal_force, Line_force, Surface_force, Boundary_condition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
number_slider_2 = Slider(1.3, range=0.1..5)
assembleloads = AssembleNodalElementAndSurfaceLoads(
    Nodal_coordinates=visualizemodel.Nodal_coordinates,
    Element_node_relationship=visualizemodel.Element_node_relationship,
    JointCondition=-9999,
    Nodal_load=-9999,
    Element_load=lineload,
    Floor_load=-9999,
    Surface_load=-9999,
    Wall_load=-9999,
    SectionArea=-9999,
    WeightDensity=-9999,
    Accuracy=1e-10)  # -> Nodal_load, Nodal_loadLocalCoordinateSystem, Nodal_coordinatesConsideringJoints
elevec = CalcElementAxisVector(Nodal_coordinates=visualizemodel.Nodal_coordinates, Element_node_relationship=visualizemodel.Element_node_relationship)
cross_sec_perf = CalcSectionPerformance(
    SectionType="1",
    Parameter1=number_slider_2,
    Parameter2=number_slider_2,
    Parameter3=-9999,
    Parameter4=-9999,
    Nodal_coordinates=visualizemodel.Nodal_coordinates,
    Element_node_relationship=visualizemodel.Element_node_relationship,
    ElementAxisVector=elevec,
    Fontsize=10,
    Unit_of_length="mm",
    Filename=" ",
    Index=-9999)  # -> SectionArea, SecondMomentOfAreaAroundYAxis, SecondMomentOfAreaAroundZAxis, StVenantsTorsionConstant, SectionModulusAroundYAxis, SectionModulusAroundZAxis, VA, RenderingShape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
number_slider_3 = Slider(99, range=1..100)
elastic_analysis = AnalysisUsingOpenSees(
    Nodal_coordinates=visualizemodel.Nodal_coordinates,
    Element_node_relationship=visualizemodel.Element_node_relationship,
    Element_node_relationshipShell=-9999,
    KABE_W=-9999,
    Nodal_force=assembleloads.Nodal_load,
    Boundary_condition=visualizemodel.Boundary_condition,
    LocalCoordinatesVector=elevec,
    JointCondition=-9999,
    SpringElement=-9999,
    YoungsMudulus=210000000,
    ShearModulus=0.3,
    SectionArea=cross_sec_perf.SectionArea,
    SecondMomentOfAreaAroundYAxis=cross_sec_perf.SecondMomentOfAreaAroundYAxis,
    SecondMomentOfAreaAroundZAxis=cross_sec_perf.SecondMomentOfAreaAroundZAxis,
    StVenantsTorsionConstant=cross_sec_perf.StVenantsTorsionConstant,
    Nodal_forceLocalCoordinateSystem=assembleloads.Nodal_loadLocalCoordinateSystem,
    Rigid=-9999,
    Option=[1, 1])  # -> R, IJ, D, reac_f, sec_f, l_vec, IJKL, D_shell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
visualizeresult = VisualizeAnalysisResult(
    Nodal_coordinates=elastic_analysis.R,
    Element_node_relationship=elastic_analysis.IJ,
    Nodal_displacements=elastic_analysis.D,
    Reaction_force=elastic_analysis.reac_f,
    Section_force=elastic_analysis.sec_f,
    ElementAxisVector=elastic_analysis.l_vec,
    KABE_W=-9999,
    Shear_w=-9999,
    Index=-9999,
    IndexKabe=-9999,
    Divide_display_points=30,
    Scale_factor_for_disp=Slider(99, range=1..100),
    Scale_factor_for_NQ=Slider(0.049, range=0.001..1),
    Scale_factor_for_M=Slider(0.003, range=0.001..1),
    Fontsize=12,
    Arcsize=0.25)  # -> Nodal_coordinates, Element_node_relationship, Section_force, KABE_W, Shear_w
