# Grasshopper definition 3-Portal Frame.gh (Grasshopper 1.0.8)
# plug-ins: Pancake, eleFront, OpenSeesUtility

width_of_frame_m = Slider(25, range=0..100)
height_of_fortal_frame_m = Slider(9.6, range=0..100)
panel = Panel("""fx
fy
fz
rx
ry
rz""")
panel_2 = Panel("""1
1
1
0
0
0""")
panel_3 = Panel("""fx
fy
fz
rx
ry
rz""")
panel_4 = Panel("""1
1
1
1
1
1""")
specify_layer_names = Panel("column")
specify_layer_names_2 = Panel("beam")
pt = ConstructPoint(XCoordinate=expr("-x/2", width_of_frame_m), YCoordinate=0, ZCoordinate=0)
pt_2 = ConstructPoint(XCoordinate=expr("x/2", width_of_frame_m), YCoordinate=0, ZCoordinate=0)
Z = UnitZ(Factor=height_of_fortal_frame_m)
layer = ModelLayer(Layer=specify_layer_names_2, Name=specify_layer_names_2)  # -> Layer, Name, Hidden, Locked, DisplayColour, Material, Linetype
layer_2 = ModelLayer(Layer=specify_layer_names, Name=specify_layer_names)  # -> Layer, Name, Hidden, Locked, DisplayColour, Material, Linetype
move = Move(Geometry=pt, Motion=Z)  # -> Geometry, Transform
move_2 = Move(Geometry=pt_2, Motion=Z)  # -> Geometry, Transform

# ----
# Create BCs
u_text = UserText(Content=pt, Keys=panel, Values=panel_2, UserTextMode=1)  # -> Content, Keys, Values
u_text_2 = UserText(Content=pt_2, Keys=panel_3, Values=panel_4, UserTextMode=1)  # -> Content, Keys, Values

line = LineSDL(Start=pt, Direction=Z, Length=Z)
line_2 = LineSDL(Start=pt_2, Direction=Z, Length=Z)
ln = Line(StartPoint=move.Geometry, EndPoint=move_2.Geometry)
ef_layer = EleFrontLayer(Layer=layer.Layer)  # -> Layer, FullPath, Hidden, Locked, DisplayColour, MaterialName, Linetype, PrintColour, PrintWidth
ef_layer_2 = EleFrontLayer(Layer=layer_2.Layer)  # -> Layer, FullPath, Hidden, Locked, DisplayColour, MaterialName, Linetype, PrintColour, PrintWidth
create_attributes = TrueOnlyButton(LastSaveLocalization="neutral,N")
panel_5 = Panel("""0
1
0""")
panel_6 = Panel("""1
0
0""")
panel_7 = Panel("""mat
sec
angle""")
panel_8 = Panel("""mat
sec
angle""")

# ----
# Create Layer
ef_att = EleFrontAttributes(Keys=panel_7, Values=panel_5, Layer=ef_layer_2.Layer)  # -> Attributes, Keys, Values, Name, Layer, ColourSource, DisplayColour, MaterialSource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

# ----
# Create Layer
ef_att_2 = EleFrontAttributes(Keys=panel_8, Values=panel_6, Layer=ef_layer.Layer)  # -> Attributes, Keys, Values, Name, Layer, ColourSource, DisplayColour, MaterialSource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

concat = Concatenate(FragmentA=specify_layer_names, FragmentB="1")
concat_2 = Concatenate(FragmentA=specify_layer_names, FragmentB="2")

# ----
# Create Beam with mat, sec and angle
bake = BakeObjects(Geometry=ln, Attributes=ef_att_2.Attributes, BakeName=specify_layer_names_2, Bake=create_attributes, createGroups=False)  # -> Message, Guids
bake_2 = BakeObjects(Geometry=line_2, Attributes=ef_att.Attributes, BakeName=concat_2, Bake=create_attributes, createGroups=False)  # -> Message, Guids
bake_3 = BakeObjects(Geometry=line, Attributes=ef_att.Attributes, BakeName=concat, Bake=create_attributes, createGroups=False)  # -> Message, Guids

panel_9 = Panel([specify_layer_names, specify_layer_names_2])
readbeam2 = ReadBeam2(
    LayerBeam=panel_9,
    NameMat="mat",
    NameSec="sec",
    NameAngle="angle",
    NameJoint="joint",
    NameLb=["lby", "lbz"],
    NameBar="bar",
    NameWick=["wickX", "wickY", "wickZ", "wickW"],
    NameEle_w=["ele_wx", "ele_wy", "ele_wz", "ele_wx2", "ele_wy2", "ele_wz2", "ele_l1", "ele_l2"],
    NameK=["kxt", "kxc", "kyt", "kyc", "kzt", "kzc", "mx", "my", "mz"],
    NameAngleSpring="angle",
    NameSpring_a=["Nta", "Nca", "Qyta", "Qyca", "Qzta", "Qzca", "Mxa", "Mya", "Mza"],
    RigidPinValue=[1e+12, 0.001],
    Accuracy=0.005)  # -> Beam, Mat, Sec, Angle, Joint, Lby, Lbz, Bar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
pt_3 = ConstructPoint(XCoordinate=expr("-x/2", width_of_frame_m), YCoordinate=0, ZCoordinate=height_of_fortal_frame_m)
pdecon = Deconstruct(Point=pt_3)  # -> XComponent, YComponent, ZComponent
assemblelines = MakeRAndIJFromGeometry(Lines=readbeam2.Beam, MaterialNoList=readbeam2.Mat, SectionNoList=readbeam2.Sec, ElementAngleList=readbeam2.Angle)  # -> Nodal_coordinates, Element_node_relationship
boundary = SetBoundaryCondition(
    Nodal_coordinates=assemblelines.Nodal_coordinates,
    XCoordinates=-9999,
    YCoordinates=-9999,
    ZCoordinates="0",
    Fx=1,
    Fy=1,
    Fz=1,
    Rx=1,
    Ry=1,
    Rz=1)
nodalload = SetNodalLoads(
    Nodal_coordinates=assemblelines.Nodal_coordinates,
    XCoordinates=pdecon.XComponent,
    YCoordinates=pdecon.YComponent,
    ZCoordinates=pdecon.ZComponent,
    AxialLoadOfXAxisDirection=Slider(33, range=1..250),
    AxialLoadOfYAxisDirection=0,
    AxialLoadOfZAxisDirection=0,
    MomentLoadAroundXAxisDirection=0,
    MomentLoadAroundYAxisDirection=0,
    MomentLoadAroundZAxisDirection=0)
visualizemodel = VisualizeStructuralModel(
    Nodal_coordinates=assemblelines.Nodal_coordinates,
    Element_node_relationship=assemblelines.Element_node_relationship,
    Element_node_relationshipShell=-9999,
    KABE_W=-9999,
    Nodal_force=nodalload,
    Line_force=-9999,
    Surface_force=-9999,
    Boundary_condition=boundary,
    JointCondition=-9999,
    SpringElement=-9999,
    Index=-9999,
    IndexShell=-9999,
    IndexKabe=-9999,
    IndexSpring=-9999,
    Fontsize=20,
    Arrowsize=0.15,
    Arcsize=0.25)  # -> Nodal_coordinates, Element_node_relationship, Element_node_relationshipShell, KABE_W, Nodal_force, Line_force, Surface_force, Boundary_condition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
elevec = CalcElementAxisVector(Nodal_coordinates=assemblelines.Nodal_coordinates, Element_node_relationship=assemblelines.Element_node_relationship)
panel_10 = Panel("""0.3
0.3
0.3""")
assembleloads = AssembleNodalElementAndSurfaceLoads(
    Nodal_coordinates=assemblelines.Nodal_coordinates,
    Element_node_relationship=assemblelines.Element_node_relationship,
    JointCondition=-9999,
    Nodal_load=nodalload,
    Element_load=-9999,
    Floor_load=-9999,
    Surface_load=-9999,
    Wall_load=-9999,
    SectionArea=-9999,
    WeightDensity=-9999,
    Accuracy=1e-10)  # -> Nodal_load, Nodal_loadLocalCoordinateSystem, Nodal_coordinatesConsideringJoints
panel_11 = Panel("""5
5
5""")
cross_sec_perf = CalcSectionPerformance(
    SectionType=panel_11,
    Parameter1=panel_10,
    Parameter2=panel_10,
    Parameter3=panel_10,
    Parameter4=panel_10,
    Nodal_coordinates=assemblelines.Nodal_coordinates,
    Element_node_relationship=assemblelines.Element_node_relationship,
    ElementAxisVector=elevec,
    Fontsize=10,
    Unit_of_length="mm",
    Filename=" ",
    Index=-9999)  # -> SectionArea, SecondMomentOfAreaAroundYAxis, SecondMomentOfAreaAroundZAxis, StVenantsTorsionConstant, SectionModulusAroundYAxis, SectionModulusAroundZAxis, VA, RenderingShape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
elastic_analysis = AnalysisUsingOpenSees(
    Nodal_coordinates=assemblelines.Nodal_coordinates,
    Element_node_relationship=assemblelines.Element_node_relationship,
    Element_node_relationshipShell=-9999,
    KABE_W=-9999,
    Nodal_force=assembleloads.Nodal_load,
    Boundary_condition=boundary,
    LocalCoordinatesVector=elevec,
    JointCondition=-9999,
    SpringElement=-9999,
    YoungsMudulus=210000000,
    ShearModulus=0.3,
    SectionArea=cross_sec_perf.SectionArea,
    SecondMomentOfAreaAroundYAxis=cross_sec_perf.SecondMomentOfAreaAroundYAxis,
    SecondMomentOfAreaAroundZAxis=cross_sec_perf.SecondMomentOfAreaAroundZAxis,
    StVenantsTorsionConstant=cross_sec_perf.StVenantsTorsionConstant,
    Nodal_forceLocalCoordinateSystem=assembleloads.Nodal_loadLocalCoordinateSystem,
    Rigid=-9999,
    Option=[1, 1])  # -> R, IJ, D, reac_f, sec_f, l_vec, IJKL, D_shell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
visualizeresult = VisualizeAnalysisResult(
    Nodal_coordinates=elastic_analysis.R,
    Element_node_relationship=elastic_analysis.IJ,
    Nodal_displacements=elastic_analysis.D,
    Reaction_force=elastic_analysis.reac_f,
    Section_force=elastic_analysis.sec_f,
    ElementAxisVector=elastic_analysis.l_vec,
    KABE_W=-9999,
    Shear_w=-9999,
    Index=-9999,
    IndexKabe=-9999,
    Divide_display_points=30,
    Scale_factor_for_disp=elastic_analysis.D_R,
    Scale_factor_for_NQ=0.1,
    Scale_factor_for_M=0.15,
    Fontsize=12,
    Arcsize=0.25)  # -> Nodal_coordinates, Element_node_relationship, Section_force, KABE_W, Shear_w
