# Grasshopper definition 4 Pt Bending Test.gh (Grasshopper 1.0.8)
# plug-ins: eleFront, OpenSeesUtility

panel = Panel("""beam1
beam2
beam3""")
number_slider = Slider(12, range=0..100)
ef_layer = EleFrontLayer(Layer=panel)  # -> Layer, FullPath, Hidden, Locked, DisplayColour, MaterialName, Linetype, PrintColour, PrintWidth
X = UnitX(Factor=number_slider)
ef_att = EleFrontAttributes(Layer=ef_layer.Layer)  # -> Attributes, Keys, Values, Name, Layer, ColourSource, DisplayColour, MaterialSource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
line = LineSDL(Start="0,0,0", Direction=X, Length=X)
divide = DivideCurve(Curve=line, Count="3", Kinks=False)  # -> Points, Tangents, Parameters
number_slider_2 = Slider(-1000, range=-1000..0)
shatter = Shatter(Curve=line, Parameters=divide.Parameters)
bake = BakeObjects(Geometry=shatter, Attributes=ef_att.Attributes, Bake=False, createGroups=False)  # -> Message, Guids
readbeam2 = ReadBeam2(
    LayerBeam=panel,
    NameMat="mat",
    NameSec="sec",
    NameAngle="angle",
    NameJoint="joint",
    NameLb=["lby", "lbz"],
    NameBar="bar",
    NameWick=["wickX", "wickY", "wickZ", "wickW"],
    NameEle_w=["ele_wx", "ele_wy", "ele_wz", "ele_wx2", "ele_wy2", "ele_wz2", "ele_l1", "ele_l2"],
    NameK=["kxt", "kxc", "kyt", "kyc", "kzt", "kzc", "mx", "my", "mz"],
    NameAngleSpring="angle",
    NameSpring_a=["Nta", "Nca", "Qyta", "Qyca", "Qzta", "Qzca", "Mxa", "Mya", "Mza"],
    RigidPinValue=[1e+12, 0.001],
    Accuracy=0.005)  # -> Beam, Mat, Sec, Angle, Joint, Lby, Lbz, Bar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
end = EndPoints(Curve=line)  # -> Start, End
pdecon = Deconstruct(Point=end.Start)  # -> XComponent, YComponent, ZComponent
pdecon_2 = Deconstruct(Point=end.End)  # -> XComponent, YComponent, ZComponent
pt = ConstructPoint(XCoordinate=expr("x/3", pdecon_2.XComponent), YCoordinate=pdecon.YComponent, ZCoordinate=pdecon_2.ZComponent)
pt_2 = ConstructPoint(XCoordinate=expr("2*(x/3)", pdecon_2.XComponent), YCoordinate=pdecon.YComponent, ZCoordinate=pdecon_2.ZComponent)
pdecon_3 = Deconstruct(Point=pt)  # -> XComponent, YComponent, ZComponent
pdecon_4 = Deconstruct(Point=pt_2)  # -> XComponent, YComponent, ZComponent
assemblelines = MakeRAndIJFromGeometry(Lines=readbeam2.Beam, MaterialNoList=readbeam2.Mat, SectionNoList=readbeam2.Sec, ElementAngleList=readbeam2.Angle)  # -> Nodal_coordinates, Element_node_relationship
nodalload = SetNodalLoads(
    Nodal_coordinates=assemblelines.Nodal_coordinates,
    XCoordinates=pdecon_3.XComponent,
    YCoordinates=pdecon_3.YComponent,
    ZCoordinates=pdecon_3.ZComponent,
    AxialLoadOfXAxisDirection=0,
    AxialLoadOfYAxisDirection=0,
    AxialLoadOfZAxisDirection=number_slider_2,
    MomentLoadAroundXAxisDirection=0,
    MomentLoadAroundYAxisDirection=0,
    MomentLoadAroundZAxisDirection=0)
nodalload_2 = SetNodalLoads(
    Nodal_coordinates=assemblelines.Nodal_coordinates,
    XCoordinates=pdecon_4.XComponent,
    YCoordinates=pdecon_4.YComponent,
    ZCoordinates=pdecon_4.ZComponent,
    AxialLoadOfXAxisDirection=0,
    AxialLoadOfYAxisDirection=0,
    AxialLoadOfZAxisDirection=number_slider_2,
    MomentLoadAroundXAxisDirection=0,
    MomentLoadAroundYAxisDirection=0,
    MomentLoadAroundZAxisDirection=0)
elevec = CalcElementAxisVector(Nodal_coordinates=assemblelines.Nodal_coordinates, Element_node_relationship=assemblelines.Element_node_relationship)
boundary = SetBoundaryCondition(
    Nodal_coordinates=assemblelines.Nodal_coordinates,
    XCoordinates=pdecon.XComponent,
    YCoordinates=pdecon.YComponent,
    ZCoordinates=pdecon.ZComponent,
    Fx=1,
    Fy=1,
    Fz=1,
    Rx=0,
    Ry=0,
    Rz=0)
boundary_2 = SetBoundaryCondition(
    Nodal_coordinates=assemblelines.Nodal_coordinates,
    XCoordinates=number_slider,
    YCoordinates=pdecon_2.YComponent,
    ZCoordinates=pdecon_2.ZComponent,
    Fx=0,
    Fy=1,
    Fz=1,
    Rx=0,
    Ry=0,
    Rz=0)
assembletreetext = AssembleTreeText(Tree=nodalload, Tree_2=nodalload_2, Tree_3="-9999", Tree_4="-9999", Tree_5="-9999")
assembletreetext_2 = AssembleTreeText(Tree=boundary, Tree_2=boundary_2, Tree_3="-9999", Tree_4="-9999", Tree_5="-9999")
visualizemodel = VisualizeStructuralModel(
    Nodal_coordinates=assemblelines.Nodal_coordinates,
    Element_node_relationship=assemblelines.Element_node_relationship,
    Element_node_relationshipShell=-9999,
    KABE_W=-9999,
    Nodal_force=assembletreetext,
    Line_force=-9999,
    Surface_force=-9999,
    Boundary_condition=assembletreetext_2,
    JointCondition=-9999,
    SpringElement=-9999,
    Index=-9999,
    IndexShell=-9999,
    IndexKabe=-9999,
    IndexSpring=-9999,
    Fontsize=Slider(10, range=1..10),
    Arrowsize=0.15,
    Arcsize=0.25)  # -> Nodal_coordinates, Element_node_relationship, Element_node_relationshipShell, KABE_W, Nodal_force, Line_force, Surface_force, Boundary_condition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
cross_sec_perf = CalcSectionPerformance(
    SectionType=Slider(1, range=0..1),
    Parameter1=Slider(0.4, range=0..1),
    Parameter2=Slider(0.2, range=0..1),
    Parameter3=-9999,
    Parameter4=-9999,
    Nodal_coordinates=assemblelines.Nodal_coordinates,
    Element_node_relationship=assemblelines.Element_node_relationship,
    ElementAxisVector=elevec,
    Fontsize=10,
    Unit_of_length="mm",
    Filename=" ",
    Index=-9999)  # -> SectionArea, SecondMomentOfAreaAroundYAxis, SecondMomentOfAreaAroundZAxis, StVenantsTorsionConstant, SectionModulusAroundYAxis, SectionModulusAroundZAxis, VA, RenderingShape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
assembleloads = AssembleNodalElementAndSurfaceLoads(
    Nodal_coordinates=assemblelines.Nodal_coordinates,
    Element_node_relationship=assemblelines.Element_node_relationship,
    JointCondition=-9999,
    Nodal_load=assembletreetext,
    Element_load=-9999,
    Floor_load=-9999,
    Surface_load=-9999,
    Wall_load=-9999,
    SectionArea=-9999,
    WeightDensity=-9999,
    Accuracy=1e-10)  # -> Nodal_load, Nodal_loadLocalCoordinateSystem, Nodal_coordinatesConsideringJoints
elastic_analysis = AnalysisUsingOpenSees(
    Nodal_coordinates=assemblelines.Nodal_coordinates,
    Element_node_relationship=assemblelines.Element_node_relationship,
    Element_node_relationshipShell=-9999,
    KABE_W=-9999,
    Nodal_force=assembleloads.Nodal_load,
    Boundary_condition=assembletreetext_2,
    LocalCoordinatesVector=elevec,
    JointCondition=-9999,
    SpringElement=-9999,
    YoungsMudulus=210000000,
    ShearModulus=0.3,
    SectionArea=cross_sec_perf.SectionArea,
    SecondMomentOfAreaAroundYAxis=cross_sec_perf.SecondMomentOfAreaAroundYAxis,
    SecondMomentOfAreaAroundZAxis=cross_sec_perf.SecondMomentOfAreaAroundZAxis,
    StVenantsTorsionConstant=cross_sec_perf.StVenantsTorsionConstant,
    Nodal_forceLocalCoordinateSystem=assembleloads.Nodal_loadLocalCoordinateSystem,
    Rigid=-9999,
    Option=[1, 1])  # -> R, IJ, D, reac_f, sec_f, l_vec, IJKL, D_shell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
visualizeresult = VisualizeAnalysisResult(
    Nodal_coordinates=assemblelines.Nodal_coordinates,
    Element_node_relationship=assemblelines.Element_node_relationship,
    Nodal_displacements=-9999,
    Reaction_force=elastic_analysis.reac_f,
    Section_force=elastic_analysis.sec_f,
    ElementAxisVector=elastic_analysis.l_vec,
    KABE_W=-9999,
    Shear_w=-9999,
    Index=-9999,
    IndexKabe=-9999,
    Divide_display_points=30,
    Scale_factor_for_disp=100,
    Scale_factor_for_NQ=0.1,
    Scale_factor_for_M=0.15,
    Fontsize=12,
    Arcsize=0.25)  # -> Nodal_coordinates, Element_node_relationship, Section_force, KABE_W, Shear_w
