# Grasshopper definition 4-Column with FIx Base and UDL in X Direction.gh (Grasshopper 1.0.8)
# plug-ins: eleFront, OpenSeesUtility

height_of_column_m = Slider(10, range=0..10)
line = LineSDL(Start="0,0,0", Direction=Vector(0, 0, 1), Length=height_of_column_m)
panel = Panel("""fx
fy
fz
rx
ry
rz""")
panel_2 = Panel("""0
0
0
0
0
0""")
panel_3 = Panel("""fx
fy
fz
rx
ry
rz""")
panel_4 = Panel("""1
1
1
1
1
1""")
end = EndPoints(Curve=line)  # -> Start, End
panel_5 = Panel("""mat
sec
angle""")
panel_6 = Panel("""0
0
0""")
layer = ModelLayer(Layer="column", Name="column")  # -> Layer, Name, Hidden, Locked, DisplayColour, Material, Linetype
ef_layer = EleFrontLayer(Layer=layer.Layer)  # -> Layer, FullPath, Hidden, Locked, DisplayColour, MaterialName, Linetype, PrintColour, PrintWidth
u_text = UserText(Content=end.End, Keys=panel, Values=panel_2, UserTextMode=1)  # -> Content, Keys, Values
u_text_2 = UserText(Content=end.Start, Keys=panel_3, Values=panel_4, UserTextMode=1)  # -> Content, Keys, Values
ef_att = EleFrontAttributes(Keys=panel_5, Values=panel_6, Layer=ef_layer.Layer)  # -> Attributes, Keys, Values, Name, Layer, ColourSource, DisplayColour, MaterialSource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
pdecon = Deconstruct(Point="0,0,0")  # -> XComponent, YComponent, ZComponent
bake = BakeObjects(Geometry=line, Attributes=ef_att.Attributes, BakeName="column", Bake=False, createGroups=False)  # -> Message, Guids
readbeam2 = ReadBeam2(
    LayerBeam="column",
    NameMat="mat",
    NameSec="sec",
    NameAngle="angle",
    NameJoint="joint",
    NameLb=["lby", "lbz"],
    NameBar="bar",
    NameWick=["wickX", "wickY", "wickZ", "wickW"],
    NameEle_w=["ele_wx", "ele_wy", "ele_wz", "ele_wx2", "ele_wy2", "ele_wz2", "ele_l1", "ele_l2"],
    NameK=["kxt", "kxc", "kyt", "kyc", "kzt", "kzc", "mx", "my", "mz"],
    NameAngleSpring="angle",
    NameSpring_a=["Nta", "Nca", "Qyta", "Qyca", "Qzta", "Qzca", "Mxa", "Mya", "Mza"],
    RigidPinValue=[1e+12, 0.001],
    Accuracy=0.005)  # -> Beam, Mat, Sec, Angle, Joint, Lby, Lbz, Bar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
assemblelines = MakeRAndIJFromGeometry(Lines=readbeam2.Beam, MaterialNoList=readbeam2.Mat, SectionNoList=readbeam2.Sec, ElementAngleList=readbeam2.Angle)  # -> Nodal_coordinates, Element_node_relationship
elevec = CalcElementAxisVector(Nodal_coordinates=assemblelines.Nodal_coordinates, Element_node_relationship=assemblelines.Element_node_relationship)
lineload = SetLineLoads(
    Nodal_coordinates=assemblelines.Nodal_coordinates,
    Element_node_relationship=assemblelines.Element_node_relationship,
    XCoordinatesOfElementCenterPoint=pdecon.XComponent,
    YCoordinatesOfElementCenterPoint=pdecon.YComponent,
    ZCoordinatesOfElementCenterPoint=-9999,
    DistributedLoadOfXAxisDirection=Slider(10, range=1..10),
    DistributedLoadOfYAxisDirection=0,
    DistributedLoadOfZAxisDirection=0)
assembleloads = AssembleNodalElementAndSurfaceLoads(
    Nodal_coordinates=assemblelines.Nodal_coordinates,
    Element_node_relationship=assemblelines.Element_node_relationship,
    JointCondition=-9999,
    Nodal_load=-9999,
    Element_load=lineload,
    Floor_load=-9999,
    Surface_load=-9999,
    Wall_load=-9999,
    SectionArea=-9999,
    WeightDensity=-9999,
    Accuracy=1e-10)  # -> Nodal_load, Nodal_loadLocalCoordinateSystem, Nodal_coordinatesConsideringJoints
boundary = SetBoundaryCondition(
    Nodal_coordinates=assemblelines.Nodal_coordinates,
    XCoordinates=pdecon.XComponent,
    YCoordinates=pdecon.YComponent,
    ZCoordinates=pdecon.ZComponent,
    Fx=1,
    Fy=1,
    Fz=1,
    Rx=1,
    Ry=1,
    Rz=1)
visualizemodel = VisualizeStructuralModel(
    Nodal_coordinates=assemblelines.Nodal_coordinates,
    Element_node_relationship=assemblelines.Element_node_relationship,
    Element_node_relationshipShell=-9999,
    KABE_W=-9999,
    Nodal_force=-9999,
    Line_force=lineload,
    Surface_force=-9999,
    Boundary_condition=boundary,
    JointCondition=-9999,
    SpringElement=-9999,
    Index=-9999,
    IndexShell=-9999,
    IndexKabe=-9999,
    IndexSpring=-9999,
    Fontsize=20,
    Arrowsize=0.15,
    Arcsize=0.25)  # -> Nodal_coordinates, Element_node_relationship, Element_node_relationshipShell, KABE_W, Nodal_force, Line_force, Surface_force, Boundary_condition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
cross_sec_perf = CalcSectionPerformance(
    SectionType="1",
    Parameter1="0.3",
    Parameter2="0.3",
    Parameter3=-9999,
    Parameter4=-9999,
    Nodal_coordinates=assemblelines.Nodal_coordinates,
    Element_node_relationship=assemblelines.Element_node_relationship,
    ElementAxisVector=elevec,
    Fontsize=10,
    Unit_of_length="mm",
    Filename=" ",
    Index=-9999)  # -> SectionArea, SecondMomentOfAreaAroundYAxis, SecondMomentOfAreaAroundZAxis, StVenantsTorsionConstant, SectionModulusAroundYAxis, SectionModulusAroundZAxis, VA, RenderingShape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
elastic_analysis = AnalysisUsingOpenSees(
    Nodal_coordinates=assemblelines.Nodal_coordinates,
    Element_node_relationship=assemblelines.Element_node_relationship,
    Element_node_relationshipShell=-9999,
    KABE_W=-9999,
    Nodal_force=assembleloads.Nodal_load,
    Boundary_condition=boundary,
    LocalCoordinatesVector=elevec,
    JointCondition=-9999,
    SpringElement=-9999,
    YoungsMudulus=210000000,
    ShearModulus=0.3,
    SectionArea=cross_sec_perf.SectionArea,
    SecondMomentOfAreaAroundYAxis=cross_sec_perf.SecondMomentOfAreaAroundYAxis,
    SecondMomentOfAreaAroundZAxis=cross_sec_perf.SecondMomentOfAreaAroundZAxis,
    StVenantsTorsionConstant=cross_sec_perf.StVenantsTorsionConstant,
    Nodal_forceLocalCoordinateSystem=assembleloads.Nodal_loadLocalCoordinateSystem,
    Rigid=-9999,
    Option=[1, 1])  # -> R, IJ, D, reac_f, sec_f, l_vec, IJKL, D_shell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
visualizeresult = VisualizeAnalysisResult(
    Nodal_coordinates=elastic_analysis.R,
    Element_node_relationship=elastic_analysis.IJ,
    Nodal_displacements=elastic_analysis.D,
    Reaction_force=elastic_analysis.reac_f,
    Section_force=elastic_analysis.sec_f,
    ElementAxisVector=elastic_analysis.l_vec,
    KABE_W=-9999,
    Shear_w=-9999,
    Index=-9999,
    IndexKabe=-9999,
    Divide_display_points=30,
    Scale_factor_for_disp=Slider(10, range=0.001..10),
    Scale_factor_for_NQ=Slider(0.001, range=0.001..10),
    Scale_factor_for_M=Slider(0.006, range=0.001..0.01),
    Fontsize=12,
    Arcsize=0.25)  # -> Nodal_coordinates, Element_node_relationship, Section_force, KABE_W, Shear_w
