# Grasshopper definition 6-BCJoint-Only Point Load on Top of Col and Beam.gh (Grasshopper 1.0.8)
# plug-ins: Pancake, eleFront, OpenSeesUtility

create_geometry = TrueOnlyButton(LastSaveLocalization="neutral,N")
panel = Panel("""beam
column""")
number_slider = Slider(10, range=0..10)
item = ListItem(List=panel, Index=0, Wrap=True)  # -> Item, Item1
ef_layer = EleFrontLayer(Layer=item.Item)  # -> Layer, FullPath, Hidden, Locked, DisplayColour, MaterialName, Linetype, PrintColour, PrintWidth
ef_layer_2 = EleFrontLayer(Layer=item.Item1)  # -> Layer, FullPath, Hidden, Locked, DisplayColour, MaterialName, Linetype, PrintColour, PrintWidth
Z = UnitZ(Factor=number_slider)
line = LineSDL(Start="0,0,0", Direction=Z, Length=number_slider)
ef_att = EleFrontAttributes(Layer=ef_layer.Layer)  # -> Attributes, Keys, Values, Name, Layer, ColourSource, DisplayColour, MaterialSource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
ef_att_2 = EleFrontAttributes(Layer=ef_layer_2.Layer)  # -> Attributes, Keys, Values, Name, Layer, ColourSource, DisplayColour, MaterialSource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
X = UnitX(Factor=number_slider)
midpt = CurveMiddle(Curve=line)
line_2 = LineSDL(Start=midpt, Direction=X, Length=number_slider)
bake = BakeObjects(Geometry=line, Attributes=ef_att.Attributes, Bake=create_geometry, createGroups=False)  # -> Message, Guids
bake_2 = BakeObjects(Geometry=line_2, Attributes=ef_att_2.Attributes, Bake=create_geometry, createGroups=False)  # -> Message, Guids
readbeam2 = ReadBeam2(
    LayerBeam=panel,
    NameMat="mat",
    NameSec="sec",
    NameAngle="angle",
    NameJoint="joint",
    NameLb=["lby", "lbz"],
    NameBar="bar",
    NameWick=["wickX", "wickY", "wickZ", "wickW"],
    NameEle_w=["ele_wx", "ele_wy", "ele_wz", "ele_wx2", "ele_wy2", "ele_wz2", "ele_l1", "ele_l2"],
    NameK=["kxt", "kxc", "kyt", "kyc", "kzt", "kzc", "mx", "my", "mz"],
    NameAngleSpring="angle",
    NameSpring_a=["Nta", "Nca", "Qyta", "Qyca", "Qzta", "Qzca", "Mxa", "Mya", "Mza"],
    RigidPinValue=[1e+12, 0.001],
    Accuracy=0.005)  # -> Beam, Mat, Sec, Angle, Joint, Lby, Lbz, Bar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
expression = Expression(x=number_slider, Expression="x/2")
pdecon = Deconstruct(Point="0,0,0")  # -> XComponent, YComponent, ZComponent
pdecon_2 = Deconstruct(Point="0,0,0")  # -> XComponent, YComponent, ZComponent
pdecon_3 = Deconstruct(Point="0,0,0")  # -> XComponent, YComponent, ZComponent
assemblelines = MakeRAndIJFromGeometry(Lines=readbeam2.Beam, MaterialNoList=readbeam2.Mat, SectionNoList=readbeam2.Sec, ElementAngleList=readbeam2.Angle)  # -> Nodal_coordinates, Element_node_relationship
boundary = SetBoundaryCondition(
    Nodal_coordinates=assemblelines.Nodal_coordinates,
    XCoordinates=pdecon.XComponent,
    YCoordinates=pdecon.YComponent,
    ZCoordinates=pdecon.ZComponent,
    Fx=1,
    Fy=1,
    Fz=1,
    Rx=0,
    Ry=0,
    Rz=0)
boundary_2 = SetBoundaryCondition(
    Nodal_coordinates=assemblelines.Nodal_coordinates,
    XCoordinates=pdecon_2.XComponent,
    YCoordinates=pdecon_2.YComponent,
    ZCoordinates=number_slider,
    Fx=1,
    Fy=1,
    Fz=0,
    Rx=0,
    Ry=0,
    Rz=0)
boundary_3 = SetBoundaryCondition(
    Nodal_coordinates=assemblelines.Nodal_coordinates,
    XCoordinates=number_slider,
    YCoordinates=pdecon_3.YComponent,
    ZCoordinates=expression,
    Fx=0,
    Fy=1,
    Fz=0,
    Rx=0,
    Ry=0,
    Rz=0)
nodalload = SetNodalLoads(
    Nodal_coordinates=assemblelines.Nodal_coordinates,
    XCoordinates=number_slider,
    YCoordinates=pdecon_2.YComponent,
    ZCoordinates=expression,
    AxialLoadOfXAxisDirection=0,
    AxialLoadOfYAxisDirection=0,
    AxialLoadOfZAxisDirection=Slider(-6, range=-100..-1),
    MomentLoadAroundXAxisDirection=0,
    MomentLoadAroundYAxisDirection=0,
    MomentLoadAroundZAxisDirection=0)
nodalload_2 = SetNodalLoads(
    Nodal_coordinates=assemblelines.Nodal_coordinates,
    XCoordinates=pdecon_2.XComponent,
    YCoordinates=pdecon_2.YComponent,
    ZCoordinates=number_slider,
    AxialLoadOfXAxisDirection=0,
    AxialLoadOfYAxisDirection=0,
    AxialLoadOfZAxisDirection=Slider(-14, range=-100..-1),
    MomentLoadAroundXAxisDirection=0,
    MomentLoadAroundYAxisDirection=0,
    MomentLoadAroundZAxisDirection=0)
assembletree = AssembleTree(Tree=boundary, Tree_2=boundary_2, Tree_3=boundary_3, Tree_4=-9999, Tree_5=-9999)
assembletree_2 = AssembleTree(Tree=nodalload_2, Tree_2=nodalload, Tree_3=-9999, Tree_4=-9999, Tree_5=-9999)
elevec = CalcElementAxisVector(Nodal_coordinates=assemblelines.Nodal_coordinates, Element_node_relationship=assemblelines.Element_node_relationship)
visualizemodel = VisualizeStructuralModel(
    Nodal_coordinates=assemblelines.Nodal_coordinates,
    Element_node_relationship=assemblelines.Element_node_relationship,
    Element_node_relationshipShell=-9999,
    KABE_W=-9999,
    Nodal_force=assembletree_2,
    Line_force=-9999,
    Surface_force=-9999,
    Boundary_condition=assembletree,
    JointCondition=-9999,
    SpringElement=-9999,
    Index=-9999,
    IndexShell=-9999,
    IndexKabe=-9999,
    IndexSpring=-9999,
    Fontsize=20,
    Arrowsize=0.15,
    Arcsize=0.25)  # -> Nodal_coordinates, Element_node_relationship, Element_node_relationshipShell, KABE_W, Nodal_force, Line_force, Surface_force, Boundary_condition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
cross_sec_perf = CalcSectionPerformance(
    SectionType="1",
    Parameter1=0.3,
    Parameter2=0.3,
    Parameter3=-9999,
    Parameter4=-9999,
    Nodal_coordinates=assemblelines.Nodal_coordinates,
    Element_node_relationship=assemblelines.Element_node_relationship,
    ElementAxisVector=elevec,
    Fontsize=10,
    Unit_of_length="mm",
    Filename=" ",
    Index=-9999)  # -> SectionArea, SecondMomentOfAreaAroundYAxis, SecondMomentOfAreaAroundZAxis, StVenantsTorsionConstant, SectionModulusAroundYAxis, SectionModulusAroundZAxis, VA, RenderingShape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
assembleloads = AssembleNodalElementAndSurfaceLoads(
    Nodal_coordinates=assemblelines.Nodal_coordinates,
    Element_node_relationship=assemblelines.Element_node_relationship,
    JointCondition=-9999,
    Nodal_load=assembletree_2,
    Element_load=-9999,
    Floor_load=-9999,
    Surface_load=-9999,
    Wall_load=-9999,
    SectionArea=-9999,
    WeightDensity=-9999,
    Accuracy=1e-10)  # -> Nodal_load, Nodal_loadLocalCoordinateSystem, Nodal_coordinatesConsideringJoints
elastic_analysis = AnalysisUsingOpenSees(
    Nodal_coordinates=assemblelines.Nodal_coordinates,
    Element_node_relationship=assemblelines.Element_node_relationship,
    Element_node_relationshipShell=-9999,
    KABE_W=-9999,
    Nodal_force=assembleloads.Nodal_load,
    Boundary_condition=assembletree,
    LocalCoordinatesVector=elevec,
    JointCondition=-9999,
    SpringElement=-9999,
    YoungsMudulus=210000000,
    ShearModulus=0.3,
    SectionArea=cross_sec_perf.SectionArea,
    SecondMomentOfAreaAroundYAxis=cross_sec_perf.SecondMomentOfAreaAroundYAxis,
    SecondMomentOfAreaAroundZAxis=cross_sec_perf.SecondMomentOfAreaAroundZAxis,
    StVenantsTorsionConstant=cross_sec_perf.StVenantsTorsionConstant,
    Nodal_forceLocalCoordinateSystem=assembleloads.Nodal_loadLocalCoordinateSystem,
    Rigid=-9999,
    Option=[1, 1])  # -> R, IJ, D, reac_f, sec_f, l_vec, IJKL, D_shell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
visualizeresult = VisualizeAnalysisResult(
    Nodal_coordinates=elastic_analysis.R,
    Element_node_relationship=elastic_analysis.IJ,
    Nodal_displacements=elastic_analysis.D,
    Reaction_force=elastic_analysis.reac_f,
    Section_force=elastic_analysis.sec_f,
    ElementAxisVector=elastic_analysis.l_vec,
    KABE_W=-9999,
    Shear_w=-9999,
    Index=-9999,
    IndexKabe=-9999,
    Divide_display_points=30,
    Scale_factor_for_disp=100,
    Scale_factor_for_NQ=Slider(0.071, range=0.001..0.1),
    Scale_factor_for_M=Slider(0.039, range=0.001..0.1),
    Fontsize=Slider(0.036, range=0.001..0.1),
    Arcsize=Slider(0.093, range=0.001..0.1))  # -> Nodal_coordinates, Element_node_relationship, Section_force, KABE_W, Shear_w
